# Grasshopper definition optimization.gh (Grasshopper 1.0.7)
# plug-ins: Hops

window_position_y = Slider(0.5, range=0.4..0.6)

window_position_x = Slider(0.5, range=0.4..0.6)
wall_window_id = Slider(1, range=0..3)
window_width = Slider(1, range=0..2)
window_height = Slider(1.7, range=0..2)
construct_point = ConstructPoint(XCoordinate=window_position_y, YCoordinate=window_position_x, ZCoordinate=0)

window_position_x_2 = Slider(0.5, range=0.4..0.6)
window_position_y_2 = Slider(0.5, range=0.4..0.6)

wall_window_id_2 = Slider(0, range=0..3)
window_width_2 = Slider(2, range=0..2)
window_height_2 = Slider(2, range=0..2)
construct_point_2 = ConstructPoint(XCoordinate=window_position_y_2, YCoordinate=window_position_x_2, ZCoordinate=0)

room_width = Slider(6, range=0..10)
room_depth = Slider(4, range=0..10)
rectangle = Rectangle(Plane=PlaneXY(0, 0, 0), XSize=room_width, YSize=room_depth, Radius=0)  # -> Rectangle, Length

curve = Curve(rectangle.Rectangle)
surface = Surface(curve)
unit_z = UnitZ(Factor=Slider(2.7, range=0..10))
extrude = Extrude(Base=surface, Direction=unit_z)
data = Data(extrude)

galapagos = Galapagos(
    fitness=average,
    gene=[wall_window_id, window_position_x, window_position_y, window_width, window_height, wall_window_id_2, window_position_x_2, window_position_y_2, window_width_2, window_height_2])

deconstruct_brep = DeconstructBrep(Brep=data)  # -> Faces, Edges, Vertices
list_item = ListItem(List=deconstruct_brep.Faces, Index=0, Wrap=True)
split_list = SplitList(List=deconstruct_brep.Faces, Index=Slider(1, range=0..1))  # -> ListA, ListB
split_list_2 = SplitList(List=split_list.ListB, Index=Slider(10, range=0..10))  # -> ListA, ListB
geometry = Geometry(split_list_2.ListA)

list_item_2 = ListItem(List=geometry, Index=wall_window_id, Wrap=True)
list_item_3 = ListItem(List=geometry, Index=wall_window_id_2, Wrap=True)
evaluate_surface = EvaluateSurface(Surface=reparameterize(list_item_2), Point=construct_point)  # -> Point, Normal, UDirection, VDirection, Frame
evaluate_surface_2 = EvaluateSurface(Surface=reparameterize(list_item_3), Point=construct_point_2)  # -> Point, Normal, UDirection, VDirection, Frame
rectangle_2 = Rectangle(Plane=evaluate_surface.Frame, XSize=window_width, YSize=window_height, Radius=0)  # -> Rectangle, Length
rectangle_3 = Rectangle(Plane=evaluate_surface_2.Frame, XSize=window_width_2, YSize=window_height_2, Radius=0)  # -> Rectangle, Length
merge = Merge(Data1=rectangle_2.Rectangle, Data2=rectangle_3.Rectangle)

data_2 = Data([data, merge])
brep_wireframe = BrepWireframe(Brep=data_2, Density=-1)
custom_preview = CustomPreview(Geometry=brep_wireframe, Material=ColourSwatch(SwatchColor=RGB(0, 0, 0)))

multiplication = Multiplication(A=Slider(0.8, range=0..1), B=-1)
genpts = LBGeneratePointGrid(geometry=list_item, grid_size=Slider(0.25, range=0..1), offset_dist=multiplication)  # -> points, vectors, face_areas, mesh; plug-in component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
data_3 = Data(merge)
deconstruct_brep_2 = DeconstructBrep(Brep=list_item)  # -> Faces, Edges, flatten(Vertices)
windows = Geometry(data_3)
surface_2 = Surface(flatten(windows))
connect_simulated_results_for_comparison = Panel("0")
deconstruct_brep_3 = DeconstructBrep(Brep=surface_2)  # -> Faces, Edges, simplify(flatten(Vertices))
point = Point(genpts.points)
mesh = Mesh(genpts.mesh)
mesh_2 = Mesh(mesh)
legendpar = LBLegendParameters(min=Slider(0, range=0..100), max=Slider(100, range=0..100))  # -> leg_par; plug-in component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

pts = Geometry(flatten(point))
roompts = Data(flatten(deconstruct_brep_2.Vertices))
windows_2 = Geometry(flatten(deconstruct_brep_3.Vertices))

hops = Hops(
    Points=pts,
    RoomCorners=roompts,
    WindowCorners=windows_2,
    SimulatedUsefulUDI=connect_simulated_results_for_comparison,
    CacheResultsInMemory=True,
    CacheSolveResults=True,
    RemoteDefinitionLocation="http://localhost:5000/omegaflux_predict",
    RemoteSolveVersion=(0, 1, 0),
    ShowInput_Enabled=False,
    ShowInput_Path=False,
    SynchronousSolve=True)  # -> UsefulUDI, UDILow, UDIUp, R2Score, RMSE, MSE
average = Average(Input=hops.UsefulUDI)
heatmap = LBSpatialHeatmap(values=hops.UsefulUDI, mesh=mesh_2, legend_par=legendpar)  # -> mesh, legend, title, colors, legend_par, vis_set; plug-in component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
average_udi_predicted = Panel(average)
data_4 = Data(heatmap.mesh)

area = Area(Geometry=mesh_2)  # -> Area, Centroid

multiplication_2 = Multiplication(A=average_udi_predicted, B=100)
round = Round(Number=multiplication_2)  # -> Nearest, Floor, Ceiling
division = Division(A=round.Nearest, B=100)
concatenate = Concatenate(FragmentA="UDI:", FragmentB=division)
text_tag_3d = TextTag3D(Location=area.Centroid, Text=concatenate, Size=Slider(0.3, range=0..1), Justification=7)
